# Dynamo graph _spaceSeparatorsFromCADLayerCurves.dyn "_rtm_spaceSeparatorsFromCADLayerCurves" (Dynamo 2.12.1.8246)
# packages: bimorphNodes 4.2.4, Clockwork for Dynamo 2.x 2.4.0

# note: Created by Michael Halili
# Client: RTM Engineering Consultants
# v1.0
# Date Revised: 06/19/2023
# Dynamo Core 2.12.1.82.46
# Dynamo Revit 2.12.1.11123
# Packages:
# bimorphNodes 4.2.4
# Clockwork for Dynamo 2.4.0
# Description:
# Open a Revit View that only displays the desired Linked CAD File.
# Script will take the Linked CAD FIle in the Active View and place Space Separator lines based on the Layer Name specified in the "CAD Layer Name" node.

# group: INPUT
# note: INPUT

# group: OPERATION
# note: OPERATION

# group: OUTPUT
# note: OUTPUT

# group: WIP
# note: WIP

# group: INPUT
enter_cad_layer_name_of = StringInput("A EXISTING INTERIOR WALL 2")  # "Enter CAD Layer Name of Boundaries (i.e. Walls, Windows, Doors)"; graph input
boolean = BoolSelector(true)

# group: OPERATION
boolean_2 = BoolSelector(true)
# note: bimorphNodes 4.2.4
python_script = Python(IN[0]=boolean_2)  # CPython3
# ---------- python_script.python (20 lines) ----------
import clr
clr.AddReference('RevitAPI')
from Autodesk.Revit.DB import *

clr.AddReference('RevitNodes')
import Revit
clr.ImportExtensions(Revit.Elements)

clr.AddReference('RevitServices')
import RevitServices
from RevitServices.Persistence import DocumentManager
from RevitServices.Transactions import TransactionManager

doc = DocumentManager.Instance.CurrentDBDocument

link = FilteredElementCollector(doc, doc.ActiveView.Id).OfClass(ImportInstance).ToElements()

toggle = IN[0]

OUT = FilteredElementCollector(doc, doc.ActiveView.Id).OfClass(ImportInstance).ToElements()
# ----------------------------------------
layerNames = Revit.ImportInstance.LayerNames(importInstance=python_script)
contains = String.Contains(string=layerNames, searchFor=enter_cad_layer_name_of, ignoreCase=boolean)
filterByBoolMask = List.FilterByBoolMask(list=layerNames, mask=contains)
code_block = CodeBlock { false; }

# group: OPERATION
# note: bimorphNodes 4.2.4
curvesFromCADLayers = CAD.CurvesFromCADLayers(importInstance=python_script, layerNames=filterByBoolMask.in, createModelCurves=code_block)
current = Document.Current()
activeView = Document.ActiveView(document=current)
sketchPlane = View.SketchPlane(view=activeView)

# group: CREATE ROOM/SPACE SEPARATORS
# note: Clockwork for Dynamo 2.4.0
fromCurve = Custom[RoomSeparator.FromCurve]()  # package Clockwork for Dynamo 2.x; Creates room separation lines from geometry curves.; unwired: curve, sketchPlane, view
fromCurve_2 = Custom[SpaceSeparator.FromCurve](curve=curvesFromCADLayers.Curve, sketchPlane=sketchPlane, view=activeView)  # package Clockwork for Dynamo 2.x; Creates space separation lines from geometry curves.

elements_created = Watch(fromCurve_2)  # graph output
