# Dynamo graph placeSleevesByVerticalPipeCoordinates.dyn (Dynamo 2.6.2.15705)
# packages: LunchBox for Dynamo 2018.7.7, bimorphNodes 4.2.4, Genius Loci 2022.9.16, Rhythm 2021.12.1

# note: Created by Michael Halili
# Client: Symetri US
# v1.01
# Date Revised: 10/21/2023
# Dynamo Core 2.12.1.82.46
# Dynamo Revit 2.12.1.11123
# Packages:
# LunchBox for Dynamo 2018.7.7
# bimorphNodes 4.2.4
# Genius Loci 2022.9.16
# Description:
# This script will place sleeve Families (Plumbing Fixture) for pipes that intersect the Linked Model Floor, at a user-specified elevation. See below for the direction from Jered w/S&K Plumbing.
# In this script, the user chooses which Level to place Sleeves, which Revit Link and associated Floor Family to check intersections with vertical Fabrication Pipes, and the Elevation from Level (Offset) in inches to place the Family. Additionally, the user can choose a Parameter and value for which to filter when running the tool (i.e. run the tool for all elements on the 'SAN' workset). The script also filters by only including vertical pipes and straight pipes (by checking if the Product Short Description starts with "Pipe"). Script will not place over existing sleeves (checks point of new sleeves vs existing sleeve geometries)
# Request from S&K Plumbing:
# Hilti Sleeve sizes are based on the Pipe Size.
# So, if it is a 4” pipe, then a 4” Hilti sleeve will be required.
# Any penetration larger than 6” will need to be Steel sleeve 1 Pipe size larger. IE an 8” riser will require a 10” sleeve.
# Any penetration smaller than 2” will receive a 2” sleeve.
# Hub Drains will receive a 4” Hilti sleeve.
# Water Closets will receive a Hilti Water Closet sleeve.
# Provent Aerators will receive a 4” Provent adapter and 4” Hilti Sleeve.
# -0'-4" and -0'-8" aerators sleeve
# Showers will receive a 6” Hilti Sleeve – this is due to the connection requirements for the fixture connection.
# Do not oversize sleeves for insulation purposes.
# Sleeves will also be needed for Island Sink water lines to loop from wall to island. Some freestanding tubs may be the same as well. These sleeves will all be 2” Hilti.

# group: OUTPUT
# note: OUTPUT

# group: OPERATION
# note: OPERATION

# group: INPUT
# note: INPUT

# group: WIP
# note: WIP

# group: SELECT LEVEL, LINK, AND LINKED MODEL FLOOR
select_linked_model = Links("TCP2_PH02_SCB_ARCH_EXTERIOR.rvt : 3 : location <Not Shared>")  # graph input
name_of_floor_family_type = StringInput("8\" Concrete Slab")  # graph input
select_level = Levels("LEVEL 02")  # graph input

# group: SELECT THE LEVEL OF LINKED MODEL FLOOR (NAME OF LEVEL IN CURRENT MODEL AND LINK MUST MATCH)
links = Links("TCP2_PH02_SCB_ARCH_EXTERIOR.rvt : 3 : location <Not Shared>")
categories = Categories("OST_Levels")
# note: bimorphNodes 4.2.4
ofCategory = Revit.LinkElement.OfCategory(linkInstance=links, category=categories)
name = Level.Name(level=select_level)
name_2 = Element.Name(element=ofCategory)
eq = name == name_2
filterByBoolMask = List.FilterByBoolMask(list=ofCategory, mask=eq)
name_3 = Element.Name(element=filterByBoolMask.in)

# group: GET THE LINKED MODEL FLOOR, FILTER BY SELECTED LEVEL
categories_2 = Categories("OST_Floors")
# note: bimorphNodes 4.2.4
ofCategory_2 = Revit.LinkElement.OfCategory(linkInstance=select_linked_model, category=categories_2)
name_4 = Element.Name(element=ofCategory_2)
eq_2 = name_4 == name_of_floor_family_type
filterByBoolMask_2 = List.FilterByBoolMask(list=ofCategory_2, mask=eq_2)
# note: Genius Loci 2022.9.16
element_level = Custom[Element Level](element=filterByBoolMask_2.in)  # package Genius Loci; Gets an element's level. Based on a Clockwork's node
name_5 = Level.Name(level=element_level)
eq_3 = name_3@L1 == name_5
flatten = List.Flatten(list=eq_3)
filterByBoolMask_3 = List.FilterByBoolMask(list=filterByBoolMask_2.in, mask=flatten)
element_level_2 = Custom[Element Level](element=filterByBoolMask_3.in)

# group: INPUT
parameter_to_filter = StringInput("Workset")  # graph input
parameter_value_to_filter = StringInput("test")  # graph input
enter_elevation_offset_from = DoubleInput(-4)  # "Enter elevation offset from Level in inches"; graph input

# group: FILTER PIPES BY WORKSET
categories_3 = Categories("OST_FabricationPipework")
all_elements_of_category = ElementsOfCategory(Category=categories_3)
# note: LunchBox for Dynamo 2018.7.7
lunchbox_get_parameter_value = Custom[LunchBox Get Parameter Value](Element=all_elements_of_category, ParamName=parameter_to_filter)  # package LunchBox for Dynamo; Gets parameter values from a Revit element.
contains = String.Contains(str=lunchbox_get_parameter_value, searchFor=parameter_value_to_filter)
flatten_2 = List.Flatten(list=contains)
filterByBoolMask_4 = List.FilterByBoolMask(list=all_elements_of_category, mask=flatten_2)

# group: FILTER VERTICAL PIPES (TOP/MIDDLE ELEV/BOTTOM VALUES, 2 MUST BE EQUAL)
enter_parameter_to_read = StringInput("Top")
# note: LunchBox for Dynamo 2018.7.7
lunchbox_get_parameter_value_2 = Custom[LunchBox Get Parameter Value](Element=filterByBoolMask_4.in, ParamName=enter_parameter_to_read)
enter_parameter_to_read_2 = StringInput("Middle Elevation")
lunchbox_get_parameter_value_3 = Custom[LunchBox Get Parameter Value](Element=filterByBoolMask_4.in, ParamName=enter_parameter_to_read_2)
eq_4 = lunchbox_get_parameter_value_2 == lunchbox_get_parameter_value_3
enter_parameter_to_read_3 = StringInput("Bottom")
lunchbox_get_parameter_value_4 = Custom[LunchBox Get Parameter Value](Element=filterByBoolMask_4.in, ParamName=enter_parameter_to_read_3)
eq_5 = lunchbox_get_parameter_value_3 == lunchbox_get_parameter_value_4
or_ = eq_4 || eq_5
flatten_3 = List.Flatten(list=or_)
filterByBoolMask_5 = List.FilterByBoolMask(list=filterByBoolMask_4.in, mask=flatten_3)

watch = Watch(filterByBoolMask_5.in)

# group: FILTER OUT FITTINGS (PRODUCT SHORT DESCRIPTION STARTS WITH 'PIPE')
string = StringInput("Product Short Description")
# note: LunchBox for Dynamo 2018.7.7
lunchbox_get_parameter_value_5 = Custom[LunchBox Get Parameter Value](Element=watch, ParamName=string)
flatten_4 = List.Flatten(list=lunchbox_get_parameter_value_5)
string_2 = StringInput("Pipe")
startsWith = String.StartsWith(str=flatten_4, searchFor=string_2)

filterByBoolMask_6 = List.FilterByBoolMask(list=watch, mask=startsWith)

# group: CREATE CURVES FROM FAB PART PIPES
# note: Filters pipes only with length > 0.
python_script = Python(IN[0]=filterByBoolMask_6.in)
# ---------- python_script.python (58 lines) ----------
# Load the Python Standard and DesignScript Libraries
import clr
clr.AddReference("RevitAPI")
import Autodesk
from Autodesk.Revit.DB import *

clr.AddReference("RevitServices")
import RevitServices
from RevitServices.Persistence import DocumentManager
from RevitServices.Transactions import TransactionManager

doc = DocumentManager.Instance.CurrentDBDocument

# The inputs to this node will be stored as a list in the IN variables.
elements = UnwrapElement(IN[0])
out = []

# Place your code below this line
#for e in elements:
for ie, e in enumerate(elements):
	if e.CenterlineLength and e.CenterlineLength > 0 and "x" not in e.ProductSizeDescription: 
		p = []
		id = e.Id 
		name = e.Name + " " + str(ie)
		origin = e.Origin
		origin_x = origin.X
		origin_y = origin.Y
		origin_z = origin.Z
		direction = e.Location.Curve.Direction
		direction_z = round(direction.Z, 1)
		
		"""
		direction = e.Location.Curve.Direction
		direction_x = round(direction.X, 1)
		direction_y = round(direction.Y, 1)
		direction_z = round(direction.Z, 1)
		"""
		
		length = e.CenterlineLength
		
		workset = doc.GetWorksetTable().GetWorkset(e.WorksetId).Name
		
		p.append(id)
		p.append(name)
		p.append(workset)
		p.append(origin_x)
		p.append(origin_y)
		p.append(origin_z)
		p.append(length)
		p.append(direction_z)
		p.append(e)
		
		out.append(p)


# Assign your output to the OUT variable.
#OUT = messageDialog.Show("hello", test_string)
OUT = out
# ----------------------------------------
watch_2 = Watch(python_script)
code_block = CodeBlock { 3; }
getItemAtIndex = List.GetItemAtIndex(list=python_script@L2, index=code_block)
code_block_2 = CodeBlock { 4; }
getItemAtIndex_2 = List.GetItemAtIndex(list=python_script@L2, index=code_block_2)
code_block_3 = CodeBlock { 5; }
getItemAtIndex_3 = List.GetItemAtIndex(list=python_script@L2, index=code_block_3)
byCoordinates = Point.ByCoordinates(x=getItemAtIndex, y=getItemAtIndex_2, z=getItemAtIndex_3)
code_block_4 = CodeBlock { 0; 0; }
code_block_5 = CodeBlock { 7; }
getItemAtIndex_4 = List.GetItemAtIndex(list=python_script@L2, index=code_block_5)
byCoordinates_2 = Vector.ByCoordinates(x=code_block_4.out0, y=code_block_4.out1, z=getItemAtIndex_4)
code_block_6 = CodeBlock { 6; }
getItemAtIndex_5 = List.GetItemAtIndex(list=python_script@L2, index=code_block_6)
byStartPointDirectionLength = Line.ByStartPointDirectionLength(startPoint=byCoordinates, direction=byCoordinates_2, length=getItemAtIndex_5)
boundingBox = Geometry.BoundingBox(geometry=byStartPointDirectionLength)

# group: GET ELEMENTS THAT HAVE LENGTH > 0.
code_block_7 = CodeBlock { 8; }
getItemAtIndex_6 = List.GetItemAtIndex(list=python_script@L2, index=code_block_7)

watch_3 = Watch(filterByBoolMask_3.in)

# group: CREATE BOUNDING BOX OF LINKED MODEL FLOOR
# note: bimorphNodes 4.2.4
boundingBox_2 = Revit.LinkElement.BoundingBox(linkElement=watch_3)
deconstruct = List.Deconstruct(list=boundingBox_2)

# group: GATHER PIPES THAT INTERSECT LINKED MODEL FLOOR
intersects = BoundingBox.Intersects(boundingBox=deconstruct.first, other=boundingBox)
filterByBoolMask_7 = List.FilterByBoolMask(list=getItemAtIndex_6, mask=intersects)
watch_4 = Watch(filterByBoolMask_7.in)

# group: SLEEVE FAMILY TYPES
family_types = FamilyTypes("2 IN HILTI SLEEVE WITH POINT:2 IN HILTI SLEEVE WITH POINT")
family_types_2 = FamilyTypes("2 IN HILTI TB CLASSIC WITH POINT:2 IN HILTI TB CLASSIC WITH POINT")
family_types_3 = FamilyTypes("3 IN HILTI SLEEVE WITH POINT:3 IN HILTI SLEEVE WITH POINT")
family_types_4 = FamilyTypes("4 IN HILTI AERATOR ADAPTER:4 IN HILTI AERATOR ADAPTER")
family_types_5 = FamilyTypes("4 IN HILTI SLEEVE WITH POINT:4 IN HILTI SLEEVE WITH POINT")
family_types_6 = FamilyTypes("4 IN HILTI WC WITH POINT:4 IN HILTI WC WITH POINT")
family_types_7 = FamilyTypes("6 IN HILTI SLEEVE WITH POINT:6 IN HILTI SLEEVE WITH POINT")
family_types_8 = FamilyTypes("8 IN & LARGER FLOOR SLEEVE:8 IN SLEEVE")
family_types_9 = FamilyTypes("8 IN & LARGER FLOOR SLEEVE:10 IN SLEEVE")
family_types_10 = FamilyTypes("8 IN & LARGER FLOOR SLEEVE:12 IN SLEEVE")

# group: DETERMINE WHICH SLEEVE IS PLACED BASED ON COMMENT OR SIZE.
python_script_2 = Python(IN[0]=filterByBoolMask_7.in, IN[1]=select_level, IN[2]=family_types, IN[3]=family_types_2, IN[4]=family_types_3, IN[5]=family_types_4, IN[6]=family_types_5, IN[7]=family_types_6, IN[8]=family_types_7, IN[9]=family_types_8, IN[10]=family_types_9, IN[11]=family_types_10, IN[12]=enter_elevation_offset_from)
# ---------- python_script_2.python (108 lines) ----------
# Load the Python Standard and DesignScript Libraries

import clr
clr.AddReference("RevitAPI")
import Autodesk
from Autodesk.Revit.DB import *

clr.AddReference("RevitServices")
import RevitServices
from RevitServices.Persistence import DocumentManager
from RevitServices.Transactions import TransactionManager

clr.AddReference("RevitAPIUI")

doc = DocumentManager.Instance.CurrentDBDocument

# The inputs to this node will be stored as a list in the IN variables.
elements = UnwrapElement(IN[0])
level = UnwrapElement(IN[1])
two_in_sleeve = UnwrapElement(IN[2])
two_in_tb_sleeve = UnwrapElement(IN[3])
three_in_sleeve = UnwrapElement(IN[4])
four_in_aerator_sleeve = UnwrapElement(IN[5])
four_in_sleeve = UnwrapElement(IN[6])
four_in_wc_sleeve = UnwrapElement(IN[7])
six_in_sleeve = UnwrapElement(IN[8])
eight_in_sleeve = UnwrapElement(IN[9])
ten_in_sleeve = UnwrapElement(IN[10])
twelve_in_sleeve = UnwrapElement(IN[11])
elevation = UnwrapElement(IN[12])

out = []

# Place your code below this line
for e in elements:
	p = []
	sleeve = 0;
	origin = e.Origin
	origin_x = origin.X
	origin_y = origin.Y
	origin_z = origin.Z
	size = e.LookupParameter("Inside Diameter").AsDouble()
	comment = e.LookupParameter("Comments").AsString()

	if comment == "UP TO WC":
		sleeve = four_in_wc_sleeve
	elif comment == "UP TO SH":
		sleeve = six_in_sleeve
	elif comment == "UP TO TB":
		sleeve = two_in_tb_sleeve
	#elif comment == "AERATOR":
		#sleeve = four_in_aerator_sleeve
		#elevation = elevation - 4
	elif comment == "UP TO MC":
		sleeve = two_in_sleeve
	else:
		if size <= 0.175:
			sleeve = two_in_sleeve
		elif size <= 0.26:
			sleeve = three_in_sleeve
		elif size <= 0.35:
			sleeve = four_in_sleeve
		elif size <= 0.51:
			sleeve = six_in_sleeve
		elif size <= 0.668:
			sleeve = ten_in_sleeve
		elif size <= 2:
			sleeve = twelve_in_sleeve

	p.append(origin_x)
	p.append(origin_y)
	p.append(origin_z)
	p.append(level)
	p.append(size)
	p.append(comment)
	p.append(sleeve)
	p.append(e.Id)
	p.append(elevation)
	out.append(p)

#The code below adds the aerator adapter sleeve for any vertical pipes with Comment value "AERATOR"
for e in elements:
	comment = e.LookupParameter("Comments").AsString()
	if comment == "AERATOR":
		q = []
		sleeve = 0;
		origin = e.Origin
		origin_x = origin.X
		origin_y = origin.Y
		origin_z = origin.Z
		size = e.LookupParameter("Inside Diameter").AsDouble()
		sleeve = four_in_aerator_sleeve
		elevation = elevation - 4
		
		q.append(origin_x)
		q.append(origin_y)
		q.append(origin_z)
		q.append(level)
		q.append(size)
		q.append(comment)
		q.append(sleeve)
		q.append(e.Id)
		q.append(elevation)
		out.append(q)
		elevation = UnwrapElement(IN[12])

# Assign your output to the OUT variable.
OUT = out
# ----------------------------------------

# group: TAKE SLEEVE FAMILIES, GATHER POINTS AND ELEVATION
code_block_8 = CodeBlock { 6; }
getItemAtIndex_7 = List.GetItemAtIndex(list=python_script_2@L2, index=code_block_8)
code_block_9 = CodeBlock { 0; }
getItemAtIndex_8 = List.GetItemAtIndex(list=python_script_2@L2, index=code_block_9)
code_block_10 = CodeBlock { 1; }
getItemAtIndex_9 = List.GetItemAtIndex(list=python_script_2@L2, index=code_block_10)
code_block_11 = CodeBlock { 8; }
getItemAtIndex_10 = List.GetItemAtIndex(list=python_script_2@L2, index=code_block_11)
number = DoubleInput(12)
div = getItemAtIndex_10 / number
byCoordinates_3 = Point.ByCoordinates(x=getItemAtIndex_8, y=getItemAtIndex_9, z=div)

# group: GET COORDINATES OF NEW SLEEVES TO CHECK IF EXISTING SLEEVE ALREADY IS IN SAME LOCATION
list_create = List.Create(item0=getItemAtIndex_7, item1=byCoordinates_3)
transpose = List.Transpose(lists=list_create)
elevation = Level.Elevation(level=select_level)
add = elevation + div
byCoordinates_4 = Point.ByCoordinates(x=getItemAtIndex_8, y=getItemAtIndex_9, z=add)

# group: CREATE BOUNDING BOX FOR EXISTING SLEEVES IN THE MODEL
list_create_2 = List.Create(item0=family_types, item1=family_types_2, item2=family_types_3, item3=family_types_4, item4=family_types_5, item5=family_types_6, item6=family_types_7, item7=family_types_8, item8=family_types_9, item9=family_types_10)
all_elements_of_family_type = ElementsOfFamilyType(Family_Type=list_create_2)
flatten_5 = List.Flatten(list=all_elements_of_family_type)
boundingBox_3 = Element.BoundingBox(element=flatten_5)

# group: CHECK WHETHER NEW SLEEVES INTERSECT EXISTING SLEEVES (BY POINT)
contains_2 = BoundingBox.Contains(boundingBox=boundingBox_3, point=byCoordinates_4@L1)
boolean = BoolSelector(true)
contains_3 = List.Contains(list=contains_2@L2, item=boolean)
filterByBoolMask_8 = List.FilterByBoolMask(list=transpose, mask=contains_3)
new_sleeves_that_can_be_placed = Watch(filterByBoolMask_8.out)  # "NEW SLEEVES THAT CAN BE PLACED WITHOUT OVERLAPPING EXISTING"

# group: CREATE NEW LIST OF NEW SLEEVES AND THEIR COORDINATES - THIS LIST ONLY INCLUDES SLEEVES THAT ARE NOT ALREADY PLACED IN SAME LOCATION
transpose_2 = List.Transpose(lists=new_sleeves_that_can_be_placed)
number_2 = DoubleInput(0)
getItemAtIndex_11 = List.GetItemAtIndex(list=transpose_2, index=number_2)
number_3 = DoubleInput(1)
getItemAtIndex_12 = List.GetItemAtIndex(list=transpose_2, index=number_3)

# group: PLACE FAMILIES!
byPointAndLevel = FamilyInstance.ByPointAndLevel(familyType=getItemAtIndex_11, point=getItemAtIndex_12, level=select_level)

# group: COUNT INSTANCES
count = List.Count(list=byPointAndLevel)

# group: GET REFERENCE LEVEL OF SLEEVE ELEMENTS
# note: Genius Loci 2022.9.16
element_level_3 = Custom[Element Level](element=byPointAndLevel)

# group: GET ELEVATION FROM LEVEL OF EACH SLEEVE INSTANCE
code_block_12 = CodeBlock { "Elevation from Level"; }
# note: LunchBox for Dynamo 2018.7.7
lunchbox_get_parameter_value_6 = Custom[LunchBox Get Parameter Value](Element=byPointAndLevel, ParamName=code_block_12)
flatten_6 = List.Flatten(list=lunchbox_get_parameter_value_6)

# group: OUTPUT
number_of_instances_placed = Watch(count)  # graph output
reference_level_of_family = Watch(element_level_3)  # "Reference Level of Family Instances Placed"; graph output
family_instances_placed = Watch(byPointAndLevel)  # graph output
elevation_from_level_of_family = Watch(flatten_6)  # "Elevation from Level of Family Instances Placed"; graph output
