# Dynamo graph setParameterBasedOnSlope.dyn (Dynamo 2.6.2.15705)
# packages: Genius Loci 2022.9.16, LunchBox for Dynamo 2018.7.7

# note: Created by Michael Halili
# Client: Symetri USA for S&K Plumbing Projects
# v1.0
# Date Revised: 08/17/2023
# Dynamo Core 2.6.2.15705
# Dynamo Revit 2.6.2.18430
# Packages:
# LunchBox for Dynamo 2018.7.7
# GeniusLoci 2022.9.16
# Description:
# This script will set the "Sym_Slope" Project Parameter to a text value based on the MEP Pipe's Slope value. The intent is to be able to create Revit views that only show gravity pipe that is not sloped for QAQC.

# group: OUTPUT
# note: OUTPUT

# group: OPERATION
# note: OPERATION

# group: INPUT
# note: INPUT

# group: WIP
# note: WIP

# group: INPUT
categories = Categories("OST_FabricationPipework")  # graph input
enter_parameter_to_read = StringInput("Slope")  # graph input
enter_slope_to_gather_as_this = StringInput("0.00°")  # "Enter Slope to gather as this format "0.00°""; graph input
enter_parameter_name_to_set = StringInput("Sym_Slope")  # graph input
enter_text_value_to_set = StringInput("0")  # graph input
string = StringInput("0\" / 12\"")

# group: Filter elements on "SAN" or "STORM - BG" or "VENT" workset
all_elements_of_category = ElementsOfCategory(Category=categories)
# note: GeniusLoci 2022.9.16
element_workset = Custom[Element Workset](element=all_elements_of_category)  # frozen; package Genius Loci; Returns the workset of the given element.
code_block = CodeBlock { "SAN"; }
eq = element_workset.Workset_Name == code_block
code_block_2 = CodeBlock { "STORM - BG"; }
eq_2 = element_workset.Workset_Name == code_block_2
or_ = eq || eq_2
code_block_3 = CodeBlock { "VENT"; }
eq_3 = element_workset.Workset_Name == code_block_3
or_2 = or_ || eq_3
filterByBoolMask = List.FilterByBoolMask(list=all_elements_of_category, mask=or_2)

# group: Filter out Vertical Pipes (Top, Middle Elevation, Bottom parameters: two of them must be true for a vertical pipe)
enter_parameter_to_read_2 = StringInput("Top")  # graph input
# note: LunchBox for Dynamo 2018.7.7
lunchbox_get_parameter_value = Custom[LunchBox Get Parameter Value](Element=filterByBoolMask.in, ParamName=enter_parameter_to_read_2)  # package LunchBox for Dynamo; Gets parameter values from a Revit element.
enter_parameter_to_read_3 = StringInput("Middle Elevation")  # graph input
lunchbox_get_parameter_value_2 = Custom[LunchBox Get Parameter Value](Element=filterByBoolMask.in, ParamName=enter_parameter_to_read_3)
eq_4 = lunchbox_get_parameter_value == lunchbox_get_parameter_value_2
enter_parameter_to_read_4 = StringInput("Bottom")  # graph input
lunchbox_get_parameter_value_3 = Custom[LunchBox Get Parameter Value](Element=filterByBoolMask.in, ParamName=enter_parameter_to_read_4)
eq_5 = lunchbox_get_parameter_value_2 == lunchbox_get_parameter_value_3
or_3 = eq_4 || eq_5
flatten = List.Flatten(list=or_3)
filterByBoolMask_2 = List.FilterByBoolMask(list=filterByBoolMask.in, mask=flatten)
watch = Watch(filterByBoolMask_2.out)

# group: Grab parameter value to read, filter only zero slopes
# note: LunchBox for Dynamo 2018.7.7
lunchbox_get_parameter_value_4 = Custom[LunchBox Get Parameter Value](Element=watch, ParamName=enter_parameter_to_read)
eq_6 = lunchbox_get_parameter_value_4 == enter_slope_to_gather_as_this
flatten_2 = List.Flatten(list=eq_6)
filterByBoolMask_3 = List.FilterByBoolMask(list=watch, mask=flatten_2)

# group: OUTPUT. Set Parameter Value
setParameterByName = Element.SetParameterByName(element=filterByBoolMask_3.in, parameterName=enter_parameter_name_to_set, value=enter_text_value_to_set)
watch_2 = Watch(setParameterByName)

# group: Option to do one workset at a time
# note: GeniusLoci 2022.9.16
element_workset_2 = Custom[Element Workset](element=all_elements_of_category)
code_block_4 = CodeBlock { "VENT"; }
eq_7 = element_workset_2.Workset_Name == code_block_4
filterByBoolMask_4 = List.FilterByBoolMask(list=all_elements_of_category, mask=eq_7)

# group: Filter only straight runs of pipe
string_2 = StringInput("Product Long Description")
getParameterValueByName = Element.GetParameterValueByName(element=filterByBoolMask_4.in, parameterName=string_2)
string_3 = StringInput("Pipe - PVC")
contains = String.Contains(str=getParameterValueByName, searchFor=string_3)
filterByBoolMask_5 = List.FilterByBoolMask(list=filterByBoolMask_4.in, mask=contains)
